# Grasshopper definition DeformedGrid.gh (Grasshopper 0.9.76)

facade = Curve(<curve referenced from the Rhino model>)

# ---- group: context
lineattractors = Curve([<curve referenced from the Rhino model> x4])
lineattractors_2 = Curve(lineattractors)

# ----
boundary = BoundarySurfaces(Edges=facade)

# ---- group: gridSettings
squaregrid = BooleanToggle(False)
srf = Surface(boundary)
squaregrid_2 = Boolean(squaregrid)
horidist = Number(Slider(100, range=0..1000))
vertdist = Number(Slider(1000, range=0..1000))
srf_2 = Surface(srf)

# ---- group: gridCreation
srf_3 = Surface(srf_2)
bool = Boolean(squaregrid_2)
num = Number(horidist)
num_2 = Number(vertdist)
bool_2 = Boolean(invert(bool))
num_3 = Number([num, num_2])
dim = Dimensions(Surface=srf_3)  # -> UDimension, VDimension
item = ListItem(List=num_3, Index=bool_2, Wrap=True)
division = Division(A=dim.UDimension, B=num)
division_2 = Division(A=dim.VDimension, B=item)
num_4 = Number(division_2)
pt = Point()
pointgrid = Point(pt)

# ----
grid = Point(pointgrid)
colnumber = Number(num_4)
partition = PartitionList(List=grid, Size=expr("x+1", colnumber))  # -> simplify(Chunks)
flip = FlipMatrix(Data=partition)
pline = PolyLine(Vertices=partition, Closed=False)
pline_2 = PolyLine(Vertices=flip, Closed=False)
verts = Curve(flatten(pline))
hori = Curve(flatten(pline_2))

crv = Curve(simplify(graft(lineattractors_2)))
planar = Planar(Curve=crv)  # -> Planar, Plane, Deviation

radiusattractors = Number(Slider(5000, range=0..10000))

attractorsradius = Number(radiusattractors)
gridsurface = Surface(srf_2)
grid_2 = Point(pointgrid)

crv_cp = CurveClosestPoint(Point=grid_2, Curve=crv)  # -> Point, Parameter, Distance
multiplication = Multiplication(A=attractorsradius, B=-1)

dist = Distance(PointA=crv_cp.Point, PointB=grid_2)  # -> simplify(Distance)
offset = Offset(Curve=crv, Distance=[attractorsradius, multiplication], Plane=planar.Plane, Corners=1)
larger = LargerThan(FirstNumber=dist, SecondNumber=attractorsradius)  # -> LargerThan, OrEqualTo
eval = Evaluate(F="x/y", x=dist, y=attractorsradius)
radiusattractors_2 = Curve(offset)
bool_3 = Boolean(invert(larger.OrEqualTo))
num_5 = Number(eval)

graph = GraphMapper(
    num_5,
    x0=0,
    x1=1,
    y0=0,
    y1=1,
    container_name="Bezier",
    cpx=[0, 1, 0.227272734, 1],
    cpy=[0, 0.003787875175, 0.9343434572, 1])
showradius = Curve(radiusattractors_2)

num_6 = Number(graph)
subtraction = Subtraction(A=eval, B=num_6)
p_n_c = PickNChoose(Pattern=bool_3, Stream0=bool_3, Stream1=subtraction)
attractorsdistancediff = Number(p_n_c)

attractorsdistancediff_2 = Number(attractorsdistancediff)
attractors = Point(crv_cp.Point)
grid_3 = Point(pointgrid)
vec2pt = Vector2Pt(PointA=grid_3, PointB=attractors, Unitize=False)  # -> simplify(Vector), Length
multiplication_2 = Multiplication(A=attractorsdistancediff_2, B=vec2pt.Vector)
vec = Vector(multiplication_2)
flip_2 = FlipMatrix(Data=vec)
ma = MassAddition(Input=flip_2)  # -> flatten(Result), PartialResults
vec_2 = Vector(ma.Result)

transformationvector = Vector(vec_2)
colnumber_2 = Number(num_4)
grid_4 = Point(grid_2)
move = Move(Geometry=grid_4, Motion=transformationvector)  # -> Geometry, Transform
partition_2 = PartitionList(List=move.Geometry, Size=expr("x+1", colnumber_2))  # -> simplify(Chunks)
flip_3 = FlipMatrix(Data=partition_2)
pline_3 = PolyLine(Vertices=partition_2, Closed=False)
pline_4 = PolyLine(Vertices=flip_3, Closed=False)
smoothpline = SmoothPolyline(Polyline=pline_3, Strength=1, Times=1)  # -> simplify(Polyline)
smoothpline_2 = SmoothPolyline(Polyline=pline_4, Strength=1, Times=1)  # -> simplify(Polyline)
reb = RebuildCurve(Curve=smoothpline, Degree=3, Count=10, Tangents=False)
reb_2 = RebuildCurve(Curve=smoothpline_2, Degree=3, Count=10, Tangents=False)
rebuiltverts = Curve(reb)
rebuilthory = Curve(reb_2)
