# Grasshopper definition Fluxs.gh (Grasshopper 0.9.76)
# plug-ins: Anemone

number_slider = Slider(100, range=0..100)
crv = Curve(<curve referenced from the Rhino model>)
pt = Point([<point referenced from the Rhino model> x10])

dim = Dimensions(Surface=crv)  # -> UDimension, VDimension
min = Minimum(A=dim.UDimension, B=dim.VDimension)
multiplication = Multiplication(A=min, B=Slider(0.05, range=0..0.1))
num = Number(multiplication)

num_2 = Number(num)
Y = UnitY(Factor=num_2)
neg = Negative(Value=number_slider)
move = Move(Geometry=pt, Motion=Y)  # -> Geometry, Transform
lng = ListLength(List=pt)
dom = ConstructDomain(DomainStart=number_slider, DomainEnd=neg)
random = Random(Range=dom, Number=lng, Seed=Slider(500, range=0..1000))
vec2pt = Vector2Pt(PointA=pt, PointB=move.Geometry, Unitize=False)  # -> Vector, Length
Z = UnitZ(Factor=1)
vrot = Rotate(Vector=vec2pt.Vector, Axis=Z, Angle=degrees(random))

number_slider_2 = Slider(80, range=0..100)
pt_2 = Point(simplify(graft(pt)))
vec = Vector(vrot)
panel = Panel(pt_2)
loop_start = LoopStart(Repeat=number_slider_2, Trigger=Button(), Data_0=pt_2, Data_1=vec)  # -> port, Counter, Data_0, Data_1
current_round = Panel(loop_start.Counter)
num_3 = Number(num)
crv_2 = Curve(crv)
item = ListItem(List=loop_start.Data_0, Index=current_round, Wrap=True)
vec_2 = Vector(simplify(flatten(loop_start.Data_1)))
vec_3 = Vector(simplify(flatten(vec_2)))
pt_3 = Point(simplify(flatten(item)))
pt_4 = Point(simplify(flatten(pt_3)))
crv_cp = CurveClosestPoint(Point=pt_3, Curve=crv_2)  # -> Point, Parameter, Distance
cps = ClosestPoints(Point=pt_4, Cloud=pt_4, Count=2)  # -> simplify(ClosestPoint), CPIndex, Distance
smaller = SmallerThan(FirstNumber=crv_cp.Distance, SecondNumber=num_3)  # -> SmallerThan, OrEqualTo
item_2 = ListItem(List=cps.Distance, Index=1, Wrap=True)  # -> flatten(Item)
item_3 = ListItem(List=cps.ClosestPoint, Index=1, Wrap=True)  # -> flatten(Item)
panel_2 = Panel(item_2)
num_4 = Number(multiplication)
vec2pt_2 = Vector2Pt(PointA=pt_3, PointB=crv_cp.Point, Unitize=False)  # -> Vector, Length
pt_5 = Point(item_3)
num_5 = Number(item_2)
multiplication_2 = Multiplication(A=num_4, B=Slider(4, range=0..10))
vec_4 = Vector(vec2pt_2.Vector)
smaller_2 = SmallerThan(FirstNumber=num_5, SecondNumber=multiplication_2)  # -> SmallerThan, OrEqualTo
num_6 = Number(multiplication)
unit = UnitVector(Vector=vec_4)
sift = SiftPattern(List=pt_4, SiftPattern=smaller_2.SmallerThan)  # -> Output0, Output1
multiplication_3 = Multiplication(A=num_6, B=Slider(0.064, range=0..0.1))
sift_2 = SiftPattern(List=vec_3, SiftPattern=smaller_2.SmallerThan)  # -> Output0, Output1
pt_6 = Point(sift.Output1)
vec2pt_3 = Vector2Pt(PointA=pt_6, PointB=pt_5, Unitize=False)  # -> Vector, Length
amp = Amplitude(Vector=vec2pt_3.Vector, Amplitude=multiplication_3)
addition = Addition(A=amp, B=sift_2.Output1)
amp_2 = Amplitude(Vector=addition, Amplitude=num_6)
combine = CombineData(Input0=sift_2.Output0, Input1=amp_2)  # -> Result, Index
vec_5 = Vector(combine.Result)
sift_3 = SiftPattern(List=vec_5, SiftPattern=smaller.OrEqualTo)  # -> Output0, Output1
rev = Reverse(Vector=sift_3.Output1)
dprod = DotProduct(VectorA=rev, VectorB=unit, Unitize=False)
eval = Evaluate(F="((2*z)*y)-x", x=rev, y=unit, z=dprod)
combine_2 = CombineData(Input0=sift_3.Output0, Input1=eval)  # -> Result, Index
move_2 = Move(Geometry=pt_3, Motion=combine_2.Result)  # -> Geometry, Transform
ins = InsertItems(List=loop_start.Data_0, Item=graft(move_2.Geometry), Indices=expr("x+1", current_round), Wrap=True)  # -> simplify(List)
loop_end = LoopEnd(port=loop_start.port, Exit=Button(), Data_0=ins, Data_1=combine_2.Result, pausedState=False, state="Constant output")  # -> Data_0, Data_1
num_7 = Number(number_slider_2)
num_8 = Number(num)
nurbs = NurbsCurve(Vertices=loop_end.Data_0, Degree=3, Periodic=False)  # -> Curve, Length, Domain
index = ItemIndex(List=loop_end.Data_0, Item=loop_end.Data_0)
division = Division(A=index, B=num_7)
multiplication_4 = Multiplication(A=num_8, B=division)
multiplication_5 = Multiplication(A=multiplication_4, B=Slider(0.5, range=0..1))
cir = Circle(Plane=loop_end.Data_0, Radius=multiplication_5)
