# Grasshopper definition LineFields.gh (Grasshopper 0.9.76)
# plug-ins: Anemone

number_slider = Slider(100, range=0..1000)
crv = Curve(<curve referenced from the Rhino model>)
crv_2 = Curve([<curve referenced from the Rhino model> x38])
end = EndPoints(Curve=crv_2)  # -> Start, End
multiplication = Multiplication(A=number_slider, B=Slider(0, range=0..1))
divide = DivideCurve(Curve=crv, Count=number_slider, Kinks=False)  # -> Points, Tangents, Parameters
vec2pt = Vector2Pt(PointA=end.Start, PointB=end.End, Unitize=False)  # -> Vector, Length
reduce = RandomReduce(List=divide.Points, Reduction=multiplication, Seed=Slider(67, range=0..100))
pt = Point(flatten(reduce))
vec = Vector(flatten(vec2pt.Vector))
pt_2 = Point(end.Start)
cps = ClosestPoints(Point=pt, Cloud=pt_2, Count=1)  # -> flatten(ClosestPoint), simplify(flatten(CPIndex)), Distance
vdis = VectorDisplay(Anchor=pt_2, Vector=vec)
number_slider_2 = Slider(0.7, range=0..1)
voronoi = Voronoi(Points=pt_2, Boundary=crv, BruteForceOverride=False)
item = ListItem(List=vec, Index=cps.CPIndex, Wrap=True)
num = Number(item)
multiplication_2 = Multiplication(A=num, B=number_slider_2)
pt_3 = Point(simplify(graft(pt)))
amp = Amplitude(Vector=item, Amplitude=multiplication_2)
move = Move(Geometry=pt, Motion=amp)  # -> graft(Geometry), Transform
ins = InsertItems(List=pt_3, Item=move.Geometry, Indices=1, Wrap=True)  # -> simplify(List)
loop_start = LoopStart(Repeat=Slider(373, range=0..1000), Trigger=Button(), Data_0=ins)  # -> port, Counter, Data_0
item_2 = ListItem(List=loop_start.Data_0, Index=loop_start.Counter, Wrap=True)  # -> Item, Item1
pt_4 = Point(flatten(item_2.Item))
pt_5 = Point(flatten(item_2.Item1))
vec_2 = Vector(flatten(vec))
pt_6 = Point(pt_2)
cps_2 = ClosestPoints(Point=pt_5, Cloud=pt_6, Count=1)  # -> ClosestPoint, simplify(flatten(CPIndex)), Distance
current_round = Panel(loop_start.Counter)
item_3 = ListItem(List=vec_2, Index=cps_2.CPIndex, Wrap=True)
vec2pt_2 = Vector2Pt(PointA=pt_4, PointB=pt_5, Unitize=False)  # -> Vector, Length
eval = Evaluate(F="((x*y)+z)/(x+1)", x=Slider(41, range=0..100), y=vec2pt_2.Vector, z=item_3)
num_2 = Number(eval)
multiplication_3 = Multiplication(A=num_2, B=number_slider_2)
amp_2 = Amplitude(Vector=item_3, Amplitude=multiplication_3)
move_2 = Move(Geometry=pt_5, Motion=amp_2)  # -> Geometry, Transform
pt_7 = Point(simplify(graft(move_2.Geometry)))
addition = Addition(A=current_round, B=2)
ins_2 = InsertItems(List=loop_start.Data_0, Item=pt_7, Indices=addition, Wrap=True)  # -> simplify(List)
running = Running(port=loop_start.port, Exit=Button(), Data_0=ins_2, pausedState=False, state="Constant output")
nurbs = NurbsCurve(Vertices=running, Degree=3, Periodic=False)  # -> Curve, Length, Domain
crv_3 = Curve(crv)
trim = TrimWithRegions(Curve=nurbs.Curve, Regions=crv_3)  # -> Inside, Outside
pt_8 = Point(running)
crv_4 = Curve(trim.Inside)
