# Grasshopper definition shards.gh (Grasshopper 0.9.76)
# plug-ins: Anemone

dom = ConstructDomain(DomainStart=Slider(0, range=0..1), DomainEnd=Slider(2, range=0..10))
crv = Curve(<curve referenced from the Rhino model>)
loop_start = LoopStart(Repeat=Slider(10, range=0..10), Trigger=Button(), Data_0=crv)  # -> port, Counter, simplify(Data_0)
addition = Addition(A=loop_start.Counter, B=1)
crv_2 = Curve(simplify(graft(loop_start.Data_0)))
multiplication = Multiplication(A=addition, B=Slider(40, range=0..100))  # -> simplify(Result)
lng = ListLength(List=flatten(crv_2))
random = Random(Range=dom, Number=lng, Seed=multiplication)  # -> simplify(graft(Random))
area = Area(Geometry=crv_2)  # -> Area, simplify(Centroid)
Y = UnitY(Factor=1)
Z = UnitZ(Factor=1)
pi = Pi(Factor=random)
vrot = Rotate(Vector=Y, Axis=Z, Angle=pi)  # -> simplify(Vector)
pl = ConstructPlane(Origin=area.Centroid, XAxis=vrot, YAxis=Z)  # -> simplify(Plane)
pcx = CurvePlane(Curve=crv_2, Plane=pl)  # -> simplify(Points), ParamsC, ParamsP
item = ListItem(List=pcx.Points, Index=1, Wrap=True)
item_2 = ListItem(List=pcx.Points, Index=0, Wrap=True)
ln = Line(StartPoint=item_2, EndPoint=item)  # -> simplify(Line)
boundary = BoundarySurfaces(Edges=crv_2)
srfsplit = SurfaceSplit(Surface=boundary, Curves=ln)  # -> simplify(graft(Fragments))
flatten = FlattenTree(Tree=srfsplit, Path="{0}")
graft = GraftTree(Tree=flatten, IncludeEmptyLists=True, IncludeNullItems=True)
debrep = DeconstructBrep(Brep=graft)  # -> Faces, simplify(Edges), Vertices
join = JoinCurves(Curves=debrep.Edges, Preserve=False)  # -> simplify(Curves)
panel = Panel(srfsplit)
loop_end = LoopEnd(port=loop_start.port, Exit=False, Data_0=join, pausedState=False, state="Constant output")
