# Grasshopper definition DOT.gh (Grasshopper 0.9.76)

crv = Curve(<curve referenced from the Rhino model>)
area = Area(Geometry=crv)  # -> Area, Centroid
scale = Scale(Geometry=crv, Center=area.Centroid, Factor=Slider(1.1, range=0..10))  # -> Geometry, Transform
dom = ConstructDomain(DomainStart=Slider(15, range=0..100), DomainEnd=Slider(60, range=0..100))
pop2d = Populate2D(Region=scale.Geometry, Count=Slider(26, range=0..100), Seed=1)
pt = Point(simplify(pop2d))
lng = ListLength(List=flatten(pt))
random = Random(Range=dom, Number=lng, Seed=2)
dom_2 = ConstructDomain(DomainStart=Slider(2, range=0..10), DomainEnd=Slider(15, range=0..100))
random_2 = Random(Range=dom_2, Number=lng, Seed=2)
subtraction = Subtraction(A=random, B=Slider(10, range=0..10))
cir = Circle(Plane=pt, Radius=random)  # -> graft(Circle)
int = Integer(random_2)
dom_3 = ConstructDomain(DomainStart=Slider(0, range=0..10), DomainEnd=subtraction)
series = Series(Start=0, Step=1, Count=int)  # -> simplify(Series)
bnd = Bounds(Numbers=series)
panel = Panel(int)
remap = RemapNumbers(Value=series, Source=bnd, Target=graft(Domain(0, 1)))  # -> Mapped, Clipped
graph = GraphMapper(
    remap.Mapped,
    x0=0,
    x1=1,
    y0=0,
    y1=1,
    container_name="Bezier",
    cpx=[0, 0.3721480668, 0.2222222239, 1],
    cpy=[0, 0.119130455, 0.702898562, 1])
panel_2 = Panel(remap.Mapped)
bnd_2 = Bounds(Numbers=graph)
remap_2 = RemapNumbers(Value=graph, Source=bnd_2, Target=graft(dom_3))  # -> Mapped, Clipped
offset = Offset(Curve=cir, Distance=expr("-x", remap_2.Mapped), Plane=PlaneXY(0, 0, 0), Corners=1)  # -> simplify(Curve)
panel_3 = Panel(offset)
path_mapper = PathMapper(offset, source="{A;B}(C)", target="{A}")
flip = FlipMatrix(Data=path_mapper)
runion = RegionUnion(Curves=flip)
boundary = BoundarySurfaces(Edges=runion)
debrep = DeconstructBrep(Brep=boundary)  # -> Faces, Edges, Vertices
crv_2 = Curve(debrep.Edges)
project = Project(Curve=path_mapper, Brep=crv, Direction=Vector(0, 0, 1))
crv_3 = Curve(<curve referenced from the Rhino model>)
boundary_2 = BoundarySurfaces(Edges=crv_3)
srf = Surface(boundary_2)
project_2 = Project(Curve=crv_2, Brep=srf, Direction=Vector(0, 0, 1))
