# Grasshopper definition HEX.gh (Grasshopper 0.9.76)

number_slider = Slider(65, range=0..100)
number_slider_2 = Slider(50, range=0..100)
number_slider_3 = Slider(53, range=0..100)
crv = Curve(<curve referenced from the Rhino model>)
sqrt = SquareRoot(Value=3)
toggle = BooleanToggle(True)
pt = Point(simplify(graft([<point referenced from the Rhino model> x4])))
multiplication = Multiplication(A=number_slider, B=2)
division = Division(A=number_slider, B=2)
eval = Evaluate(F="(x*y)/2", x=number_slider, y=sqrt)
offset = Offset(Curve=crv, Distance=multiplication, Plane=PlaneXY(0, 0, 0), Corners=1)  # -> flatten(Curve)
X = UnitX(Factor=division)
Y = UnitY(Factor=number_slider)
area = Area(Geometry=crv)  # -> Area, Centroid
cir = Circle(Plane=pt, Radius=number_slider_3)
num = Number(expr("2*x", eval))
addition = Addition(A=X, B=Y)
num_2 = Number(number_slider)
panel = Panel(offset)
scale = Scale(Geometry=crv, Center=area.Centroid, Factor=Slider(1.5, range=0..10))  # -> Geometry, Transform
rec = Rectangle(scale.Geometry)
panel_2 = Panel(eval)

boundary = BoundarySurfaces(Edges=offset)
dim = Dimensions(Surface=boundary)  # -> UDimension, VDimension
division_2 = Division(A=dim.UDimension, B=num_2)
division_3 = Division(A=dim.VDimension, B=num)
sdivide = DivideSurface(Surface=boundary, UCount=division_2, VCount=division_3)  # -> Points, Normals, Parameters

dom = ConstructDomain(DomainStart=Slider(4, range=0..10), DomainEnd=Slider(7, range=0..10))
move = Move(Geometry=sdivide.Points, Motion=addition)  # -> Geometry, Transform
dom_2 = ConstructDomain(DomainStart=0, DomainEnd=division)
pt_2 = Point(flatten([sdivide.Points, move.Geometry]))
data = Data(pt_2)
cluster = Cluster(data=data)
boundary_2 = BoundarySurfaces(Edges=crv)
data_2 = Data(cluster)
pt_3 = Point(simplify(flatten(data_2)))
voronoi = Voronoi(Points=flatten(data_2), Boundary=rec, BruteForceOverride=False)
crv_2 = Curve(<curve referenced from the Rhino model>)
boundary_3 = BoundarySurfaces(Edges=crv_2)
srf = Surface(boundary_3)

dist = Distance(PointA=flatten(pt_3), PointB=pt)  # -> simplify(Distance)

larger = LargerThan(FirstNumber=dist, SecondNumber=number_slider_3)  # -> LargerThan, OrEqualTo
panel_3 = Panel(dist)
bool = Boolean(invert(larger.LargerThan))
multiplication_2 = Multiplication(A=dist, B=bool)

bnd = Bounds(Numbers=multiplication_2)
remap = RemapNumbers(Value=multiplication_2, Source=bnd, Target=Domain(0, 1))  # -> Mapped, Clipped

flip = FlipMatrix(Data=remap.Mapped)
avr = Average(Input=flip)  # -> flatten(ArithmeticMean)
bnd_2 = Bounds(Numbers=avr)
remap_2 = RemapNumbers(Value=avr, Source=bnd_2, Target=dom)  # -> Mapped, Clipped
int = Integer(remap_2.Mapped)
div = DivideDomain(Domain=dom_2, Count=int)
dedomain = DeconstructDomain(Domain=div)  # -> simplify(Start), End
panel_4 = Panel(int)
offset_2 = Offset(Curve=graft(voronoi), Distance=expr("-x", dedomain.Start), Plane=PlaneXY(0, 0, 0), Corners=1)
project = Project(Curve=offset_2, Brep=srf, Direction=Vector(0, 0, 1))

# ==== cluster Cluster
data = ClusterInput()
data_2 = Data(data)
null = NullItem(Item=data_2)  # -> NullFlags, InvalidFlags, Description
cull = CullPattern(List=data_2, CullPattern=invert(null.NullFlags))
data_3 = Data(cull)
data_4 = ClusterOutput(data_3)
