# Grasshopper definition WAVE.gh (Grasshopper 0.9.76)

number_slider = Slider(88, range=0..100)
number_slider_2 = Slider(48, range=0..100)
number_slider_3 = Slider(150, range=0..1000)
number_slider_4 = Slider(100, range=0..100)
crv = Curve(<curve referenced from the Rhino model>)
pt = Point(graft([<point referenced from the Rhino model> x3]))
offset = Offset(Curve=crv, Distance=Slider(50, range=0..100), Plane=PlaneXY(0, 0, 0), Corners=1)
cir = Circle(Plane=pt, Radius=number_slider_3)

boundary = BoundarySurfaces(Edges=offset)
dim = Dimensions(Surface=boundary)  # -> UDimension, VDimension
division = Division(A=dim.UDimension, B=Slider(10, range=5..100))
division_2 = Division(A=dim.VDimension, B=Slider(6, range=0..10))
sdivide = DivideSurface(Surface=boundary, UCount=division, VCount=division_2)  # -> Points, Normals, Parameters

pt_2 = Point(simplify(sdivide.Points))
pt_3 = Point(simplify(flatten(pt_2)))
boundary_2 = BoundarySurfaces(Edges=crv)
crv_2 = Curve(<curve referenced from the Rhino model>)
boundary_3 = BoundarySurfaces(Edges=crv_2)
srf = Surface(boundary_3)

dist = Distance(PointA=flatten(pt_3), PointB=pt)  # -> simplify(Distance)

larger = LargerThan(FirstNumber=dist, SecondNumber=number_slider_3)  # -> LargerThan, OrEqualTo
bool = Boolean(invert(larger.LargerThan))
multiplication = Multiplication(A=dist, B=bool)

bnd = Bounds(Numbers=multiplication)
remap = RemapNumbers(Value=dist, Source=bnd, Target=Domain(0, 1))  # -> Mapped, Clipped

graph = GraphMapper(
    remap.Mapped,
    x0=0,
    x1=1,
    y0=0,
    y1=1,
    container_name="Bezier",
    cpx=[0, 0.6014492512, 0.2463768125, 1],
    cpy=[1, 0.3333333433, 0.08695652336, 0])
multiplication_2 = Multiplication(A=graph, B=bool)

vec2pt = Vector2Pt(PointA=flatten(pt_3), PointB=pt, Unitize=False)  # -> Vector, Length
multiplication_3 = Multiplication(A=multiplication_2, B=vec2pt.Vector)
flip = FlipMatrix(Data=multiplication_3)  # -> simplify(Data)
dispatch = Dispatch(List=flip, DispatchPattern=Toggle(False))  # -> ListA, ListB
rev = Reverse(Vector=dispatch.ListB)
vec = Vector([rev, dispatch.ListA])
ma = MassAddition(Input=vec)  # -> flatten(Result), PartialResults

move = Move(Geometry=pt_3, Motion=ma.Result)  # -> Geometry, Transform
unflatten = UnflattenTree(Tree=move.Geometry, Guide=sdivide.Points)
flip_2 = FlipMatrix(Data=unflatten)
intcrv = Interpolate(Vertices=flip_2, Degree=3, Periodic=False, KnotStyle=1)  # -> Curve, Length, Domain
intcrv_2 = Interpolate(Vertices=unflatten, Degree=3, Periodic=False, KnotStyle=1)  # -> Curve, Length, Domain
panel = Panel(unflatten)
reb = RebuildCurve(Curve=intcrv_2.Curve, Count=10, Tangents=False)
reb_2 = RebuildCurve(Curve=intcrv.Curve, Count=10, Tangents=False)
project = Project(Curve=reb_2, Brep=srf, Direction=Vector(0, 0, 1))
panel_2 = Panel(project)
